# Grasshopper definition animated_logo2.gh (Grasshopper 1.0.7)
# plug-ins: The Dominion

number_slider = Slider(1, range=0..1)
number_slider_2 = Slider(0.25, range=0..1)
range = Range(Domain=Domain(0, 1), Steps=Slider(4, range=0..10))
graph = GraphMapper(
    number_slider,
    x0=0,
    x1=1,
    y0=0,
    y1=1,
    container_name="Bezier",
    cpx=[0, 0.3405288458, 0.3701967895, 1],
    cpy=[0, 0.2045137882, 0.01167231798, 0])
graph_2 = GraphMapper(
    range,
    x0=0,
    x1=1,
    y0=0,
    y1=1,
    container_name="Bezier",
    cpx=[0, 0.1968622655, 0.3771377802, 1],
    cpy=[0.1577655077, 0.3743407726, 0.5277413726, 0.5464143753])
graph_3 = GraphMapper(
    number_slider,
    x0=0,
    x1=1,
    y0=0,
    y1=1,
    container_name="Bezier",
    cpx=[0, 0.4926505685, 0.4712155163, 1],
    cpy=[0.5024106503, 0.2366161346, 0.9439724684, 0.529204607])
graph_4 = GraphMapper(
    number_slider,
    x0=0,
    x1=1,
    y0=0,
    y1=1,
    container_name="Bezier",
    cpx=[0, 0.6432081461, 1, 1],
    cpy=[0, 0.3032419086, 0.1376729608, 1])
graph_5 = GraphMapper(number_slider, x0=0, x1=1, y0=0, y1=1, container_name="Bezier", cpx=[0, 0, 1, 1], cpy=[1, 0, 0, 0.2692618966])
expression = Expression(x=graph, y=Slider(1.987, range=0..16), Expression="2*pi*x*y")
panel = Panel(expression)
xy = XYPlane(Origin=Point(0, 0, 0))
expression_2 = Expression(x=graph_3, Expression="2*x")
panel_2 = Panel(expression_2)
prot = RotatePlane(Plane=xy, Angle=expression)
multiplication = Multiplication(A=graph_4, B=graph_2)
domlogo = DominionLogo(Plane=prot, Ratio=expression_2, Thickness=graph_5, Borders=multiplication)  # -> Logo, Borders
boundary = BoundarySurfaces(Edges=domlogo.Logo)
boundary_2 = BoundarySurfaces(Edges=domlogo.Borders)
merge = Merge(Data1=boundary, Data2=boundary_2)
preview = CustomPreview(Geometry=merge, Material=ColourSwatch(SwatchColor=RGB(18, 18, 18)))
