# Grasshopper definition parabola_test.gh (Grasshopper 1.0.7)
# plug-ins: The Dominion

pt = Point([Point(-3.084339037, 5.679518989, 0), Point(1.592237881, 5.735414331, 0), Point(0.4435081025, 0.3365683896, 0)])
xy = XYPlane(Origin=Point(0, 0, 0))
pi = Pi(Factor=Slider(0.24, range=0..1))
item = ListItem(List=pt, Index=0, Wrap=True)  # -> Item, Item1, Item2
dom = ConstructDomain(DomainStart=Slider(-10, range=-10..10), DomainEnd=Slider(10, range=-10..10))
prot = RotatePlane(Plane=xy, Angle=pi)
range = Range(Domain=dom, Steps=Slider(40, range=0..100))
solveparab3 = _3PointParabolaSolver(Plane=prot, P1=item.Item, P2=item.Item1, P3=item.Item2)
crv = Curve(solveparab3)
deconic = DeconstructConic(Conic=solveparab3)  # -> ConicSection, Focus1, Focus2, BasePlane, A, B, C, D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
evalconic = EvaluateConicAt(Conic=solveparab3, XPostion=range)  # -> PointsX, PointsY
panel = Panel(deconic.BasePlane)
