# Grasshopper definition 4 point test.gh (Grasshopper 1.0.7)
# plug-ins: The-Dominion

pt = Point([Point(-32.01528684, 32.11343066, 0), Point(-27.06119408, -32.46659844, 0), Point(-85.68957848, 1.389179729, -1.278976924e-12), Point(-1880.220323, 3.076849549, 0)])
dom = ConstructDomain(DomainStart=Slider(-69.004, range=-200..100), DomainEnd=Slider(4.189, range=-100..100))
pi = Pi(Factor=Slider(-0.507, range=-1..1))
range = Range(Domain=dom, Steps=Slider(100, range=0..100))
xy = XYPlane(Origin=Point(0, 0, 0))
prot = RotatePlane(Plane=xy, Angle=pi)
subset = SubList(List=pt, Domain=Slider(2, range=0..10), Wrap=True)  # -> List, Index
pt_2 = ConstructPoint(XCoordinate=range, YCoordinate=0, ZCoordinate=0)  # -> graft(Point)
crossref = CrossReference(ListA=subset.List, ListB=pt_2, CrossMode=1)  # -> ListA, ListB
merge = Merge(Data1=crossref.ListA, Data2=pt_2)
solveconic4 = _4PointConicSolver(Plane=prot, Points=merge)
deconic = DeconstructConic(Conic=solveconic4)  # -> ConicSection, Focus1, Focus2, BasePlane, A, B, C, D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
crv = Curve(deconic.ConicSection)
